# Dynamo graph FAM_Purge.dyn (Dynamo 2.16.4.10216)
# packages: Crumple 2026.7.1, archi-lab.net 2023.213.1722, Genius Loci 2024.5.29

directory_path = Directory("D:\1.PROJETS\04.FAMILLES\ELEC\CHU_ELE")

# group: familles hôtes
directory_from_path = DirectoryObject(path=directory_path)
code_block = CodeBlock { "*.rfa"; true; }
getDirectoryContents = FileSystem.GetDirectoryContents(directory=directory_from_path, searchString=code_block.out0)
familydoc_open = Custom[© FamilyDoc.Open](filePaths=getDirectoryContents.files)  # package Crumple; Given a file path to a family, attempts to open that document in the background in Revit if possible. Should not be used for regular models/templates.

purge_unused = Python(IN[0]=familydoc_open.familyDocs)  # CPython3; frozen
# ---------- purge_unused.python (28 lines) ----------
import clr, sys

# Références Revit & Dynamo
clr.AddReference('RevitServices')
from RevitServices.Persistence import DocumentManager

clr.AddReference('RevitAPI')
from Autodesk.Revit.DB import *

# Chargement d’eTransmit pour Revit 2023
sys.path.append(r'C:\Program Files\Autodesk\eTransmit for Revit 2023')
clr.AddReference('eTransmitForRevitDB')
import eTransmitForRevitDB as eTransmit

# Application Revit
uiapp = DocumentManager.Instance.CurrentUIApplication
app   = uiapp.Application

# IN[0] : liste de FamilyDocument déjà ouverts
family_docs = IN[0]

# Purge unused (5 passes) pour chaque document
for fam_doc in family_docs:
    for _ in range(5):
        eTransmit.eTransmitUpgradeOMatic(app).purgeUnused(fam_doc)

# On ne sauve ni ne ferme ici, on renvoie juste les documents
OUT = family_docs
# ----------------------------------------
saveas_compact = Python(IN[0]=purge_unused)  # CPython3; unwired: IN[1]
# ---------- saveas_compact.python (40 lines) ----------
import clr
clr.AddReference('RevitAPI')
from Autodesk.Revit.DB import SaveAsOptions

import os

# 📥 Entrées depuis Dynamo
docs_familles = IN[0]  # Liste de documents de familles déjà ouverts
dossier = IN[1]        # Chemin du dossier cible

# 📤 Liste des résultats
resultats = []

for doc in docs_familles:
    try:
        # 📛 Nom du fichier .rfa
        nom_fichier = os.path.basename(doc.PathName)
        if not nom_fichier.lower().endswith(".rfa"):
            nom_fichier += ".rfa"

        # 📁 Nouveau chemin de sauvegarde
        chemin_sauvegarde = os.path.join(dossier, nom_fichier)

        # ⚙️ Options d'enregistrement
        options = SaveAsOptions()
        options.Compact = True
        options.OverwriteExistingFile = True

        # 💾 Sauvegarde
        doc.SaveAs(chemin_sauvegarde, options)

        # ❌ Fermeture du document
        doc.Close(False)  # False = ne pas enregistrer à nouveau

        resultats.append(f"✅ Sauvegardé et fermé : {chemin_sauvegarde}")
    except Exception as e:
        resultats.append(f"⚠️ Erreur : {str(e)}")

# 🔄 Sortie vers Dynamo
OUT = resultats
# ----------------------------------------
watch = Watch(saveas_compact)
directory_path_2 = Directory("D:\1.PROJETS\04.FAMILLES\ELEC\CHU_ELE\2D_Symboles")

# group: familles imbriquées
directory_from_path_2 = DirectoryObject(path=directory_path_2)
getDirectoryContents_2 = FileSystem.GetDirectoryContents(directory=directory_from_path_2, searchString=code_block.out0)
familydoc_open_2 = Custom[© FamilyDoc.Open](filePaths=getDirectoryContents_2.files)

injecterNestedFamilies = Python(IN[0]=familydoc_open.familyDocs, IN[1]=familydoc_open_2.familyDocs)  # IronPython2
# ---------- injecterNestedFamilies.python (80 lines) ----------
import clr

# --- Références Revit ---
clr.AddReference('RevitAPI')
from Autodesk.Revit.DB import *

clr.AddReference('RevitServices')
import RevitServices
from RevitServices.Persistence import DocumentManager

# --- Classe FamilyOption pour contrôler le rechargement des familles ---
class FamilyOption(IFamilyLoadOptions):
	def OnFamilyFound(self, familyInUse, overwriteParameterValues):
		overwriteParameterValues = True
		return True

	def OnSharedFamilyFound(self, sharedFamily, familyInUse, source, overwriteParameterValues):
		source = FamilySource.Family
		overwriteParameterValues = True
		return True

opts = FamilyOption()

# --- Entrées Dynamo ---
# IN[0] : Liste des documents familles hôtes (host_family_docs)
# IN[1] : Liste des documents familles imbriquées (nested_family_docs)
host_family_docs = IN[0] or []
nested_family_docs = IN[1] or []

# --- Résultats ---
results = []

# --- Boucle sur chaque famille hôte ---
for host_doc in host_family_docs:
    try:
        # Récupération des noms des familles déjà présentes dans la famille hôte
        existing_family_names = set(f.Name for f in FilteredElementCollector(host_doc).OfClass(Family))
        loaded_names = []

        # Transaction Revit
        tx = Transaction(host_doc, "Chargement des familles imbriquées")
        tx.Start()

        for nested_doc in nested_family_docs:
            nested_name = nested_doc.Title  # Nom de la famille imbriquée

            # Charger uniquement si la famille imbriquée existe dans l'hôte
            if nested_name in existing_family_names:
                try:
                    # Charger la famille imbriquée
                    host_doc.LoadFamily(nested_doc.PathName, opts)
                    loaded_names.append("Chargée : {}".format(nested_name))
                except Exception as e:
                    loaded_names.append("Erreur avec {} : {}".format(nested_name, e))
            else:
                # La famille imbriquée n'est pas présente dans l'hôte
                loaded_names.append("Ignorée (non présente dans hôte) : {}".format(nested_name))

        tx.Commit()

        results.append({
            "Famille_hôte": host_doc.Title,
            "Résultat": loaded_names
        })

    except Exception as e_host:
        results.append({
            "Famille_hôte": host_doc.Title,
            "Erreur": str(e_host)
        })

# --- Fermeture des documents imbriqués ---
for nested_doc in nested_family_docs:
    try:
        nested_doc.Close(False)  # False = ne pas sauvegarder
    except: 
        pass

# --- Sortie finale ---
OUT = results
# ----------------------------------------
passThrough = Custom[PassThrough](passThrough=familydoc_open.familyDocs, waitFor=injecterNestedFamilies)  # package archi-lab.net; Ripped this off from Clockwork. Sorry Andy.
purge_unused_2 = Custom[Purge Unused](RunIt=code_block.out1, Deeply=code_block.out1, document=passThrough)  # package Genius Loci; Purge the document completely including materials an assets using the API. The optional input "deeply" allows to purge unused view templates, unused view filters, imported line Patterns from DWG and "Imports in Families" Object Styles. Can be used with documents open in the background. Works only in Revit 2017 and later.
passThrough_2 = Custom[PassThrough](passThrough=familydoc_open.familyDocs, waitFor=purge_unused_2.Count)
saveas_compact_2 = Python(IN[0]=passThrough_2)  # CPython3
# ---------- saveas_compact_2.python (51 lines) ----------
import clr
clr.AddReference('RevitAPI')
from Autodesk.Revit.DB import SaveAsOptions

import os

# 📥 Entrée depuis Dynamo
docs_familles = IN[0]  # Liste de documents de familles déjà ouverts

# 📤 Liste des résultats
resultats = []

for doc in docs_familles:
    try:
        # 📂 Chemin actuel de la famille
        chemin_actuel = doc.PathName
        
        # Si la famille n'est pas encore enregistrée, doc.PathName peut être vide
        if not chemin_actuel:
            resultats.append(f"⚠️ Impossible de déterminer le chemin pour la famille '{doc.Title}' (non enregistrée).")
            continue

        # 📛 Nom du fichier .rfa
        nom_fichier = os.path.basename(chemin_actuel)
        if not nom_fichier.lower().endswith(".rfa"):
            nom_fichier += ".rfa"

        # 📁 Répertoire d'origine
        dossier_origine = os.path.dirname(chemin_actuel)

        # 📁 Nouveau chemin de sauvegarde = même dossier + même nom
        chemin_sauvegarde = os.path.join(dossier_origine, nom_fichier)

        # ⚙️ Options d'enregistrement
        options = SaveAsOptions()
        options.Compact = True
        options.OverwriteExistingFile = True

        # 💾 Sauvegarde
        doc.SaveAs(chemin_sauvegarde, options)

        # ❌ Fermeture du document
        doc.Close(False)  # False = ne pas enregistrer à nouveau

        resultats.append(f"✅ Sauvegardé et fermé : {chemin_sauvegarde}")

    except Exception as e:
        resultats.append(f"⚠️ Erreur avec '{doc.Title}' : {str(e)}")

# 🔄 Sortie vers Dynamo
OUT = resultats
# ----------------------------------------
watch_2 = Watch(saveas_compact_2)
familydoc_getparameters = Custom[© FamilyDoc.GetParameters]()  # frozen; package Crumple; Given a family document or list of them, returns all parameters and their properties in those documents. You can provide optionally provide parameter names to get just those parameters.; unwired: familyDocs
familyparam_formulae = Custom[© FamilyParam.Formulae](familyParams=familydoc_getparameters.parameterLists@L2)  # package Crumple; For a family parameter of list of them, returns their formula if any.
anyTrue = List.AnyTrue(list=familyparam_formulae.hasFormula@L2)
filterByBoolMask = List.FilterByBoolMask(list=familydoc_getparameters.familyDocs, mask=anyTrue)
filterByBoolMask_2 = List.FilterByBoolMask(list=familydoc_getparameters.parameterLists, mask=familyparam_formulae.hasFormula)
filterByBoolMask_3 = List.FilterByBoolMask(list=familyparam_formulae.formulae, mask=familyparam_formulae.hasFormula)
code_block_2 = CodeBlock { "CHU_Ouverture extérieure hauteur"; }
code_block_3 = CodeBlock { "Hauteur brute"; }
replace = String.Replace(string=filterByBoolMask_3.in@L2, searchFor=code_block_2, replaceWith=code_block_3)
code_block_4 = CodeBlock { "CHU_Ouverture extérieure largeur"; }
code_block_5 = CodeBlock { "Largeur brute"; }
replace_2 = String.Replace(string=replace@L2, searchFor=code_block_4, replaceWith=code_block_5)
familydoc_setformulae = Custom[© FamilyDoc.SetFormulae](familyDocs=filterByBoolMask.in, nameOrParamLists=filterByBoolMask_2.in, formulaeLists=replace_2)  # package Crumple; Given a list of family documents, parmeters, and formula lists the node will attempt to set the parameter formulae.
watch_3 = Watch(familydoc_setformulae.resultLists)
passThrough_3 = Custom[PassThrough](waitFor=watch_3)  # unwired: passThrough
familydoc_closeandsave = Custom[© FamilyDoc.CloseAndSave](familyDocs=passThrough_3)  # package Crumple; Attempts to close a family document or list of family documents, and save the families in the process to their current location.
watch_4 = Watch(familydoc_closeandsave)
code_block_6 = CodeBlock { "CHU_Ouverture extérieure hauteur"; "CHU_Ouverture extérieure largeur"; }
list_create = List.Create(item0=code_block_6.out0, item1=code_block_6.out1)
familydoc_removeparameters = Custom[© FamilyDoc.RemoveParameters](nameOrParamLists=list_create)  # frozen; package Crumple; Given a family document or list of them, attempts to remove parameters in them. Input structures should be in the form of one sub-list per family document, in a list (but the node will try to create this data structure if not, as well as repeat the last list if they are shorter than the family document list).; unwired: familyDocs
passThrough_4 = Custom[PassThrough](passThrough=familydoc_removeparameters.familyDocs, waitFor=familydoc_removeparameters.resultLists)
familydoc_closeandsave_2 = Custom[© FamilyDoc.CloseAndSave](familyDocs=passThrough_4)
watch_5 = Watch(familydoc_closeandsave_2)

# group: familles purgé
directory_from_path_3 = DirectoryObject()  # unwired: path
code_block_7 = CodeBlock { "*.rfa"; true; }
getDirectoryContents_3 = FileSystem.GetDirectoryContents(directory=directory_from_path_3, searchString=code_block_7.out0)
familydoc_open_3 = Custom[© FamilyDoc.Open](filePaths=getDirectoryContents_3.files)

purge_unused_3 = Custom[Purge Unused](RunIt=code_block_7.out1, Deeply=code_block_7.out1, document=familydoc_open_3.familyDocs)
passThrough_5 = Custom[PassThrough](passThrough=familydoc_open_3.familyDocs, waitFor=purge_unused_3.Count)
saveas_compact_3 = Python(IN[0]=passThrough_5)  # CPython3; same code as saveas_compact_2
watch_6 = Watch(saveas_compact_3)
directory_path_3 = Directory("D:\1.PROJETS\04.FAMILLES\FEN\Composants\0.Annexes")
directory_path_4 = Directory("D:\1.PROJETS\04.FAMILLES\FEN\Composants")
directory_path_5 = Directory("D:\1.PROJETS\04.FAMILLES\FEN")
directory_path_6 = Directory("D:\1.PROJETS\04.FAMILLES\PRT\Composants")
directory_path_7 = Directory("D:\1.PROJETS\04.FAMILLES\PRT")
